% Simulink data dictionary LACS.sldd

headwayoffset = Simulink.Parameter(1.524, Unit="m")
PB1_decel = Simulink.Parameter(3, Unit="Mpa")
PB2_decel = Simulink.Parameter(5, Unit="Mpa")
PB3_decel = Simulink.Parameter(8, Unit="Mpa")
ESA_Passive = Simulink.Parameter(1)
ESA_Standby = Simulink.Parameter(2)
ESA_Active = Simulink.Parameter(3)
EgoWidth = Simulink.Parameter(1.628, Unit="m")
LatDis = Simulink.Parameter(0.5, Unit="m")
egoSpdLimit_L = Simulink.Parameter(10, Unit="kmph")
coefficient = Simulink.Parameter(0.8)
g = Simulink.Parameter(9.8, Unit="N/m^2")
wheelbase = Simulink.Parameter(1.625, Unit="m")
LatSafetyThershold = Simulink.Parameter(0.5, Unit="m")
SteerAngleLimit = Simulink.Parameter(20, Unit="degree")
StrAngThershold = Simulink.Parameter(0, Unit="degree")
LatAccelThershold = Simulink.Parameter(0.05, Unit="m/s^2")
EgoLength = Simulink.Parameter(3.048, Unit="m")
SteerAngleSpdLimit = Simulink.Parameter(20, Unit="degree/s")
StrAngSpdThershold = Simulink.Parameter(0.05, Unit="degree/s")
driver_decel = Simulink.Parameter(4, Unit="Mpa")
Time2React = Simulink.Parameter(1.2, Unit="s")
timeMargin = Simulink.Parameter(0.5, Unit="s")
LengthObj = Simulink.Parameter(3, Unit="m")
ESA_mask_1 = Simulink.Parameter(31)
ESA_mask_2 = Simulink.Parameter(15)
ESA_mask_4 = Simulink.Parameter(31)
egoSpdLimit_H = Simulink.Parameter(150, Unit="kmph")
ESA_mask_3 = Simulink.Parameter(255)
TTCthreshold1 = Simulink.Parameter(2.5, Unit="s")
TTCthreshold3 = Simulink.Parameter(1, Unit="s")
ObjWidth = Simulink.Parameter(2, Unit="m")

egopath = [0 0
 0.25 4.053048e-06
 0.5 3.216317e-05
 0.75 0.0001076729
 1 0.0002531529
 1.25 0.0004904106
 1.5 0.0008404984
 1.75 0.001323722
 2 0.00195965
 2.25 0.002767121
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 ]

Detal_ref = [0.0002211696; 0.0002211696; 0.0002433932; 0.0002678437; 0.0002947427; 0.0003243339; 0.0003568848; 0.000392689; 0.0004320689; 0.0004753781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 1.934212e-13]
Phi_dot_ref = [0.0008506522; 0.0008506522; 0.000936128; 0.001030168; 0.001133626; 0.001247439; 0.001372634; 0.001510343; 0.001661804; 0.001828378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 7.439277e-13]
Phi_ref = [0.0003840625; 0.0004227107; 0.0004652433; 0.0005120497; 0.0005635582; 0.0006202395; 0.0006826114; 0.0007512431; 0.0008267603; 0.0009098505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 -3.172779e-13]
X_dot_ref = repmat(10, 400, 1)
X_ref = [0.05; 0.55; 1.05; 1.55; 2.05; 2.55; 3.05; 3.55; 4.05; 4.55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 199.55]
Y_dot_ref = [0.004436377; 0.004436377; 0.004882732; 0.005373932; 0.00591447; 0.006509284; 0.007163806; 0.007884004; 0.008676441; 0.009548328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 -3.357314e-12]
Y_ref = [0.002001633; 0.002203172; 0.002424991; 0.002669127; 0.002937824; 0.003233547; 0.003559012; 0.003917202; 0.004311402; 0.004745224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 -1.65]